# Grasshopper definition Colorramp.gh (Grasshopper 0.9.76)
# plug-ins: MeshEdit Components

brep = Brep(<brep referenced from the Rhino model>)
mesh_brep = MeshBrep(
    Brep=brep,
    Settings={GridMaxCount=0, GridMinCount=16, JaggedSeams=False, MaxEdgeLength=0, MinEdgeLength=0.0001, MinTolerance=0, Refine=True, RefineAngle=0, RelativeTolerance=0.65, SimplePlanes=True, Tolerance=0})
triangulate = Triangulate(Mesh=mesh_brep)  # -> Mesh, Count
face_boundaries = FaceBoundaries(Mesh=triangulate.Mesh)
area = Area(Geometry=face_boundaries)  # -> Area, Centroid
deconstruct = Deconstruct(Point=area.Centroid)  # -> XComponent, YComponent, ZComponent
sort_list = SortList(Keys=deconstruct.ZComponent)  # -> Keys, ValuesValuesA
list_item = ListItem(List=sort_list.Keys, Index=0, Wrap=True)
list_item_2 = ListItem(List=reverse(sort_list.Keys), Index=0, Wrap=True)
gradient = Gradient(
    LowerLimit=list_item,
    UpperLimit=list_item_2,
    Parameter=deconstruct.ZComponent,
    stops=[0: RGB(19, 26, 28), 0: RGB(157, 188, 101), 0: RGB(193, 23, 213), 0: RGB(248, 249, 169), 0.15: RGB(255, 130, 160), 0.306: RGB(242, 47, 41), 0.63: RGB(20, 97, 9), 0.807: RGB(220, 0, 40)])
mesh_explode = MeshExplode(Mesh=triangulate.Mesh, Interpolate=False)
mesh_colours = MeshColours(Mesh=graft(mesh_explode), Colours=graft(gradient))  # -> flatten(Mesh)
mesh_join = MeshJoin(Meshes=mesh_colours)
