# Grasshopper definition drainScript.ghx (Grasshopper 0.9.76)
# plug-ins: Python Interpreter

range = Range(Domain=Domain(0, 1), Steps=10)
graph = GraphMapper(
    range,
    x0=0,
    x1=1,
    y0=0,
    y1=1,
    container_name="Bezier",
    cpx=[0, 0.3390050232, 0.5763636231, 1],
    cpy=[0.410000205, 0.195029512, 0, 0.3081817627])
graph_2 = GraphMapper(
    range,
    x0=0,
    x1=1,
    y0=0,
    y1=1,
    container_name="Bezier",
    cpx=[0, 0.2429089993, 0.5454545617, 1],
    cpy=[0.3584726453, 0.3864004016, 0.1117817238, 0.227272734])
graph_3 = GraphMapper(
    range,
    x0=0,
    x1=1,
    y0=0,
    y1=1,
    container_name="Bezier",
    cpx=[0, 0.25, 0.5695453882, 1],
    cpy=[0.5518181324, 0.25, 0.3554548919, 0])
weave = Weave(Pattern=[0, 1, 2], Stream0=graft(graph), Stream1=graft(graph_2), Stream2=graft(graph_3), NullGaps=False)
flip = FlipMatrix(Data=weave)
viewer = ParamViewer(flip)
lng = ListLength(List=viewer)
subtraction = Subtraction(A=lng, B=1)
range_2 = Range(Domain=Domain(0, 1), Steps=subtraction)
pt = PointXYZ(XComponent=range, YComponent=graft(range_2), ZComponent=flip)
crv = Curve(Vertices=pt, Degree=3, Periodic=False)  # -> Curve, Length, Domain
loft = Loft(
    Section=flatten(crv.Curve),
    Options={Adjust=False, Closed=False, LoftEnds=0, LoftSimp=0, LoftType=0, Rebuild=10, Refit=0.01})
md_slider = MDSlider(
    slider_value=Point(0.5150318146, 0.487862587, 0.5),
    SliderMode=0,
    x_domain=Domain(0, 1),
    y_domain=Domain(0, 1),
    z_domain=Domain(0, 1))
scale = Scale(Geometry=loft, Center=Point(0, 0, 0), Factor=Slider(20, range=0..100))  # -> Geometry, Transform
srf = Surface(scale.Geometry)
divide_surface = DivideSurface(Surface=srf, UCount=10, VCount=10)  # -> Points, Normals, Parameters
eval = EvaluateSurface(Surface=reparameterize(srf), Point=md_slider)  # -> Point, Normal, Frame
sdivide = DivideSurface(Surface=srf, UCount=10, VCount=10)  # -> Points, Normals, Parameters
pt_2 = Point(eval.Point)
python = PythonScript(
    code="""import Rhino



class DrainBoid(object):
    def __init__(self, point3d, surface, stepsize=0.5, maxsteps=None, tolerance=0.001):
        self.start = point3d
        self.pos = self.start
        result, self.u, self.v = surface.ClosestPoint(self.pos)
        self.surface = surface
        self.stepsize = stepsize
        self.points = [self.start]
        self.state = 'on'
        self.tolerance = tolerance
        self.maxsteps = maxsteps

    def makeDrainCurve(self):
        i = 0
        while self.state == 'on':
            i += 1
            if self.maxsteps:
                if i >= self.maxsteps:
                    self.state = 'finished'
            self.nextStep()
        return Rhino.Geometry.Curve.CreateControlPointCurve(self.points, 1)

    def nextStep(self):
        result, newFrame = self.surface.FrameAt(self.u, self.v)
        # create a vector from newFrame XAxis
        downVect = newFrame.XAxis
        # figure out hw far to rotate it.
        deltaAngle = Rhino.Geometry.Vector3d.VectorAngle( downVect, Rhino.Geometry.Vector3d(0.0, 0.0, -1.0), newFrame )
        # rotate it in the plane
        downVect.Rotate( deltaAngle, newFrame.ZAxis)
        # set the length
        downVect = downVect.Multiply( self.stepsize, downVect )
        spacePoint = Rhino.Geometry.Point3d.Add(self.pos, downVect)
        result, self.u, self.v = self.surface.ClosestPoint(spacePoint)
        out, newPoint, vects = self.surface.Evaluate(self.u, self.v, 0)
        if newPoint.Z >= self.pos.Z: # if higher
            self.state = 'finished'
        elif not self.checkTolerance(newPoint): # if too close
            self.state = 'finished'
        else:
            self.updatePos( newPoint )

    def updatePos(self, newPoint):
        self.points.append(newPoint)
        self.pos = newPoint

    def checkTolerance(self, other):
        # checks against another point
        # if it is outside of tolerance, returns True
        return self.pos.DistanceTo( other ) > self.tolerance

if terrainSurface:
    b = DrainBoid(startPoint, terrainSurface, stepSize, maxSteps, tol)
    a = b.makeDrainCurve()""",
    startPoint=divide_surface.Points,
    terrainSurface=srf,
    stepSize=Slider(0.5, range=0..10),
    maxSteps=Slider(302, range=0..1000),
    tol=Slider(0.058, range=0..1),
    GhMemory=0)  # -> out, a; inputs startPoint: Point3d, terrainSurface: Surface, stepSize: Double, maxSteps: Int32, tol: Double
#   port code: Python script to execute
# ---------- python: Python ----------
import Rhino

class DrainBoid(object):
    def __init__(self, point3d, surface, stepsize=0.5, maxsteps=None, tolerance=0.001):
        self.start = point3d
        self.pos = self.start
        result, self.u, self.v = surface.ClosestPoint(self.pos)
        self.surface = surface
        self.stepsize = stepsize
        self.points = [self.start]
        self.state = 'on'
        self.tolerance = tolerance
        self.maxsteps = maxsteps

    def makeDrainCurve(self):
        i = 0
        while self.state == 'on':
            i += 1
            if self.maxsteps:
                if i >= self.maxsteps:
                    self.state = 'finished'
            self.nextStep()
        return Rhino.Geometry.Curve.CreateControlPointCurve(self.points, 1)

    def nextStep(self):
        result, newFrame = self.surface.FrameAt(self.u, self.v)
        # create a vector from newFrame XAxis
        downVect = newFrame.XAxis
        # figure out hw far to rotate it.
        deltaAngle = Rhino.Geometry.Vector3d.VectorAngle( downVect, Rhino.Geometry.Vector3d(0.0, 0.0, -1.0), newFrame )
        # rotate it in the plane
        downVect.Rotate( deltaAngle, newFrame.ZAxis)
        # set the length
        downVect = downVect.Multiply( self.stepsize, downVect )
        spacePoint = Rhino.Geometry.Point3d.Add(self.pos, downVect)
        result, self.u, self.v = self.surface.ClosestPoint(spacePoint)
        out, newPoint, vects = self.surface.Evaluate(self.u, self.v, 0)
        if newPoint.Z >= self.pos.Z: # if higher
            self.state = 'finished'
        elif not self.checkTolerance(newPoint): # if too close
            self.state = 'finished'
        else:
            self.updatePos( newPoint )

    def updatePos(self, newPoint):
        self.points.append(newPoint)
        self.pos = newPoint

    def checkTolerance(self, other):
        # checks against another point
        # if it is outside of tolerance, returns True
        return self.pos.DistanceTo( other ) > self.tolerance

if terrainSurface:
    b = DrainBoid(startPoint, terrainSurface, stepSize, maxSteps, tol)
    a = b.makeDrainCurve()
# ---------- end python ----------
crv_2 = Curve(python.a)
panel = Panel(python.out)
panel_2 = Panel(python.a)
